vi "PDT Batch.gvi"   [LabVIEW NXG 1.0.0]
inputs:
  "PDT *.csv FilePath": path = path "C:\\somewhere\\somename.csv"
  "Batch PDT FilePath": path = path "C:\\somewhere\\somename.txt"
panel controls:
  "Button": bool
panel indicators:
  "Batch PDTs": string
  "size(s)": i32
uses:
  NI::G Core::File IO (General)::Read From Spreadsheet File (string).gvi
diagram:
  w1 = ","  # delimiter (\t)
  call "Read From Spreadsheet File (string).gvi"(format="%s", file path=$"PDT *.csv FilePath", delimiter=w1) -> (all rows=w2)
  # UPDATE PDT 334C939A &
  # COUNTRY_STATE_PROV = USMT &
  # LOC_NAME = "16199102 SAND ISLAND, MIDWAY" &
  # LATITUDE = 357222 &
  # LONGITUDE = -1152326 &
  # MANUFACTR_ID = "SUTRON" &
  # MODEL_NO = "G5" &
  # NMC_FLAG = Y &
  # PMAINT_EMAIL = "nos.co-ops.pdt@noaa.gov" &
  # END
  s1 = ""  # shift register
  for {
    w3 = each element of w2
    Array Index(array=w3) -> (out0[1]=w4)
    Concatenate Strings("COUNTRY_STATE_PROV = ", w4, " &\r\n") -> w5
    Array Index(array=w3) -> (out0[2]=w6)
    Concatenate Strings("LOC_NAME = \"", w6, "\" ", " &\r\n") -> w7
    Array Index(array=w3) -> (out0[3]=w8)
    Concatenate Strings("LATITUDE = ", w8, " &\r\n") -> w9
    Array Index(array=w3) -> (out0[4]=w10)
    Concatenate Strings("LONGITUDE = ", w10, " &\r\n") -> w11
    Array Index(array=w3) -> (out0[5]=w12)
    Concatenate Strings("MANUFACTR_ID = ", w12, " &\r\n") -> w13
    Array Index(array=w3) -> (out0[6]=w14)
    Concatenate Strings("MODEL_NO =  ", w14, " &\r\n") -> w15
    Array Index(array=w3) -> (out0[7]=w16)
    Concatenate Strings("NMC_FLAG = ", w16, " &\r\n") -> w17
    Array Index(array=w3) -> (out0[8]=w18)
    Concatenate Strings("PMAINT_EMAIL = ", w18, " &\r\n", "END\r\n\r\n") -> w19
    # For Each Row, Build PDT and Add CRLF
    Array Index(array=w3) -> (out0[0]=w20)
    Concatenate Strings("UPDATE PDT  ", w20, " &\r\n") -> w21
    Concatenate Strings(w21, w5, w7, w9, w11, w13, w15, w17, w19) -> w22
    Concatenate Strings(s1, w22) -> w23  # Add This PDT to Growing List
    Array Size(array=w3) -> (size(s)=w24)
    $"size(s)" <- w24
    next s1 = w23
  }
  Write To Text File(file (use dialog)=$"Batch PDT FilePath", text=s1)
  $"Batch PDTs" <- s1
